# Dynamo graph test.dyn (Dynamo 1.3.0.875)

file_path = Filename("C:\Users\Mostapha\Documents\code\ladybug-tools\dynosaur\test.py")
fromPath = FileObject(file_path)  # "File.FromPath"
readText = File.ReadText(fromPath)
python_script_from_string = PythonStringNode(script=readText)
byPoints = Polygon.ByPoints(python_script_from_string)
watch = Watch(readText)
watch_2 = Watch(python_script_from_string)
